# Grasshopper definition Polypus.gh (Grasshopper 0.9.80)

of_arms = Slider(8, range=0..20)
material_thickness_mm = Slider(2.85, range=0..5)
total_diameter_mm = Slider(203.2, range=0..300)
body_total_width_ratio = Number(0.51)
_2 = Integer(2)
small_body_width = Number(10.95)
large_body_width = Number(16.21)
division = Division(A=total_diameter_mm, B=_2)
tab_length_ratio = Division(A=small_body_width, B=large_body_width)
octopus_body_radius = Multiplication(A=division, B=body_total_width_ratio)
body_radius = Number(octopus_body_radius)

# ---- group: Creating large circle and tabs
_2_2 = Integer(2)
large_body_circle = Circle(Plane=PlaneXY(0, 0, 0), Radius=body_radius)
division_2 = Division(A=body_radius, B=_2_2)
_0_5 = Number(-0.5)
multiplication = Multiplication(A=material_thickness_mm, B=_0_5)
subtraction = Subtraction(A=body_radius, B=division_2)
vector_xyz = VectorXYZ(XComponent=multiplication, YComponent=subtraction, ZComponent=0)  # -> Vector, Length
tab = Rectangle(Plane=PlaneXY(0, 0, 0), XSize=material_thickness_mm, YSize=division_2, Radius=0)  # -> Rectangle, Length
move = Move(Geometry=tab.Rectangle, Motion=vector_xyz.Vector)  # -> Geometry, Transform
polar_array = PolarArray(Geometry=move.Geometry, Plane=PlaneXY(0, 0, 0), Count=of_arms, Angle=6.283185307)  # -> Geometry, Transform
large_circle_tabs = Group([polar_array.Geometry, large_body_circle])

# ----
material_thickness = Number(material_thickness_mm)
new_original_tentacle_size = Division(A=octopus_body_radius, B=large_body_width)
small_large_circle_ratio = Number(tab_length_ratio)

# ---- group: Larger body tab
_2_3 = Integer(2)
divide = Division(A=large_body_width, B=_2_3)
original_large_tab_y_val = Number(-14)
divide_2 = Division(A=material_thickness, B=_2_3)
scaled_tab_length = Multiplication(A=divide, B=new_original_tentacle_size)
subtraction_2 = Subtraction(A=original_large_tab_y_val, B=divide_2)
vector_xyz_2 = VectorXYZ(XComponent=0, YComponent=subtraction_2, ZComponent=0)  # -> Vector, Length
large_tab_rectangle = Rectangle(Plane=PlaneXY(0, 0, 0), XSize=scaled_tab_length, YSize=material_thickness, Radius=0)  # -> Rectangle, Length
multiplication_2 = Multiplication(A=vector_xyz_2.Vector, B=new_original_tentacle_size)
move_2 = Move(Geometry=large_tab_rectangle.Rectangle, Motion=multiplication_2)  # -> Geometry, Transform

# ---- group: Creating small circle and tabs
small_circle_x_vector = VectorXYZ(XComponent=division, YComponent=0, ZComponent=0)  # -> Vector, Length
small_tabs_scale = ScaleNU(Geometry=move.Geometry, Plane=PlaneXY(0, 0, 0), ScaleX=1, ScaleY=small_large_circle_ratio, ScaleZ=1)  # -> Geometry, Transform
small_circle_scale = Scale(Geometry=large_body_circle, Center=Point(0, 0, 0), Factor=small_large_circle_ratio)  # -> Geometry, Transform
polar_array_2 = PolarArray(Geometry=small_tabs_scale.Geometry, Plane=PlaneXY(0, 0, 0), Count=of_arms, Angle=6.283185307)  # -> Geometry, Transform
move_small_circle = Move(Geometry=[polar_array_2.Geometry, small_circle_scale.Geometry], Motion=small_circle_x_vector.Vector)  # -> Geometry, Transform

# ---- group: Visual separation between circles and tentacles
_2_4 = Integer(2)
multiplication_3 = Multiplication(A=body_radius, B=_2_4)
vector_xyz_3 = VectorXYZ(XComponent=0, YComponent=multiplication_3, ZComponent=0)  # -> Vector, Length

# ---- group: Tentacle piece
tentacle_shape = Geometry([<curve referenced from the Rhino model> x5])
scale = Scale(Geometry=tentacle_shape, Center=Point(0, 0, 0), Factor=new_original_tentacle_size)  # -> Geometry, Transform

# ----
spacer_between_parts = Number(2.2)

# ---- group: Smaller body tab
distance_between_slots = Number(-10)
multiplication_4 = Multiplication(A=distance_between_slots, B=new_original_tentacle_size)
vector_xyz_4 = VectorXYZ(XComponent=0, YComponent=multiplication_4, ZComponent=0)  # -> Vector, Length
move_3 = Move(Geometry=move_2.Geometry, Motion=vector_xyz_4.Vector)  # -> Geometry, Transform
scale_nu = ScaleNU(Geometry=move_3.Geometry, Plane=PlaneXY(0, 0, 0), ScaleX=tab_length_ratio, ScaleY=1, ScaleZ=1)  # -> Geometry, Transform

# ----
addition = Addition(A=division, B=spacer_between_parts)
both_circles_move = Move(Geometry=[large_circle_tabs, move_small_circle.Geometry], Motion=vector_xyz_3.Vector)  # -> Geometry, Transform
vector_xyz_5 = VectorXYZ(XComponent=addition, YComponent=0, ZComponent=0)  # -> Vector, Length
tentacle_linear_array = LinearArray(Geometry=[move_2.Geometry, scale.Geometry, scale_nu.Geometry], Direction=vector_xyz_5.Vector, Count=of_arms)  # -> Geometry, Transform
things_to_bake = Group([tentacle_linear_array.Geometry, both_circles_move.Geometry])
