# Grasshopper definition FinalLamp.gh (Grasshopper 0.9.80)

# ---- group: Tile oval geometry across revolved hexagon side
lofted_hexagon_side = Surface(<surface referenced from the Rhino model>)
divide_domain² = DivideDomain²(Domain=lofted_hexagon_side, UCount=Slider(16, range=0..100), VCount=Slider(5, range=0..100))
geometry = Geometry(<curve referenced from the Rhino model>)
box = Box({Plane=PlaneXY(406.8923048, -67.17949192, -9.035898385), X=Domain(0, 100.3589838), Y=Domain(0, 100.3589838), Z=Domain(0, 20.07179677)})
surface_box = SurfaceBox(Surface=lofted_hexagon_side, Domain=divide_domain², Height=1)
box_morph = BoxMorph(Geometry=geometry, Reference=box, Target=surface_box)

# ----
_6 = Number(6)
polar_array = PolarArray(Geometry=box_morph, Plane=PlaneXY(0, 0, 0), Count=_6, Angle=6.283185307)  # -> Geometry, Transform
full_hexagon_of_circles_to_bake = Group(polar_array.Geometry)
