# Grasshopper definition OctoIris.gh (Grasshopper 0.9.80)

geometry = Geometry(<curve referenced from the Rhino model>)
surface = Surface(<surface referenced from the Rhino model>)
box = Box({Plane=PlaneXY(40, 60, 0), X=Domain(0, 40), Y=Domain(0, 40), Z=Domain(0, 8)})
divide_domain² = DivideDomain²(Domain=surface, UCount=Slider(22, range=0..100), VCount=Slider(4, range=0..100))
surface_box = SurfaceBox(Surface=surface, Domain=divide_domain², Height=1)
box_morph = BoxMorph(Geometry=geometry, Reference=box, Target=surface_box)
